# Grasshopper definition hue_gl_to_gh.gh (Grasshopper 1.0.7)
# plug-ins: ShapeDiverForGrasshopper, BitmapPlus

panel = Panel("""// Grey
// ----------------------------------------------------------------------------

$N0001: rgb(88.76% 88.76% 88.76%);
$N0002: rgb(79.95% 79.95% 79.95%);
$N0003: rgb(71.32% 71.32% 71.32%);
$N0004: rgb(62.88% 62.88% 62.88%);
$N0005: rgb(54.65% 54.65% 54.65%);
$N0006: rgb(46.63% 46.63% 46.63%);
$N0007: rgb(38.86% 38.86% 38.86%);
$N0008: rgb(31.35% 31.35% 31.35%);
$N0009: rgb(24.13% 24.13% 24.13%);

// Salmon
// ----------------------------------------------------------------------------

$N0151: rgb(98.15% 85.74% 86.65%);
$N0152: rgb(93.43% 75.38% 76.87%);
$N0153: rgb(88.46% 65.13% 67.32%);
$N0154: rgb(83.24% 54.96% 58.02%);
$N0155: rgb(77.76% 44.79% 49%);
$N0156: rgb(65.49% 38.78% 42.05%);
$N0157: rgb(53.61% 32.9% 35.3%);
$N0158: rgb(42.16% 27.16% 28.77%);
$N0159: rgb(31.17% 21.55% 22.48%);

// Orange
// ----------------------------------------------------------------------------

$N0301: rgb(97.92% 86.01% 84.47%);
$N0302: rgb(93.06% 75.8% 73.66%);
$N0303: rgb(87.92% 65.73% 63.13%);
$N0304: rgb(82.51% 55.77% 52.91%);
$N0305: rgb(76.82% 45.88% 43.04%);
$N0306: rgb(64.75% 39.63% 37.22%);
$N0307: rgb(53.05% 33.53% 31.56%);
$N0308: rgb(41.77% 27.58% 26.06%);
$N0309: rgb(30.95% 21.8% 20.75%);

// Amber
// ----------------------------------------------------------------------------

$N0451: rgb(97.09% 86.47% 82.58%);
$N0452: rgb(91.82% 76.52% 70.87%);
$N0453: rgb(86.29% 66.73% 59.48%);
$N0454: rgb(80.5% 57.1% 48.43%);
$N0455: rgb(74.45% 47.62% 37.75%);
$N0456: rgb(62.83% 41% 32.95%);
$N0457: rgb(51.58% 34.55% 28.26%);
$N0458: rgb(40.71% 28.29% 23.68%);
$N0459: rgb(30.27% 22.22% 19.24%);

// Yellow
// ----------------------------------------------------------------------------

$N0601: rgb(95.69% 87.08% 81.1%);
$N0602: rgb(89.8% 77.46% 68.69%);
$N0603: rgb(83.7% 68.02% 56.61%);
$N0604: rgb(77.37% 58.78% 44.87%);
$N0605: rgb(70.83% 49.74% 33.48%);
$N0606: rgb(59.89% 42.68% 29.52%);
$N0607: rgb(49.29% 35.82% 25.62%);
$N0608: rgb(39.05% 29.17% 21.8%);
$N0609: rgb(29.2% 22.76% 18.05%);

// Lime
// ----------------------------------------------------------------------------

$N0751: rgb(93.84% 87.8% 80.14%);
$N0752: rgb(87.13% 78.54% 67.26%);
$N0753: rgb(80.28% 69.48% 54.72%);
$N0754: rgb(73.29% 60.63% 42.51%);
$N0755: rgb(66.14% 52.01% 30.57%);
$N0756: rgb(56.08% 44.5% 27.2%);
$N0757: rgb(46.32% 37.2% 23.86%);
$N0758: rgb(36.88% 30.15% 20.55%);
$N0759: rgb(27.8% 23.37% 17.26%);

// Ecru
// ----------------------------------------------------------------------------

$N0901: rgb(91.63% 88.56% 79.77%);
$N0902: rgb(83.95% 79.67% 66.7%);
$N0903: rgb(76.23% 70.97% 53.97%);
$N0904: rgb(68.46% 62.48% 41.54%);
$N0905: rgb(60.62% 54.21% 29.32%);
$N0906: rgb(51.58% 46.27% 26.22%);
$N0907: rgb(42.81% 38.57% 23.12%);
$N0908: rgb(34.31% 31.13% 20.03%);
$N0909: rgb(26.13% 23.99% 16.95%);

// Olive
// ----------------------------------------------------------------------------

$N1051: rgb(89.19% 89.31% 80.01%);
$N1052: rgb(80.43% 80.77% 67.06%);
$N1053: rgb(71.73% 72.4% 54.42%);
$N1054: rgb(63.07% 64.21% 42.08%);
$N1055: rgb(54.44% 56.21% 29.94%);
$N1056: rgb(46.56% 47.89% 26.72%);
$N1057: rgb(38.89% 39.83% 23.51%);
$N1058: rgb(31.45% 32.05% 20.32%);
$N1059: rgb(24.28% 24.58% 17.14%);

// Green
// ----------------------------------------------------------------------------

$N1201: rgb(86.67% 90.01% 80.86%);
$N1202: rgb(76.77% 81.78% 68.3%);
$N1203: rgb(66.99% 73.68% 56.05%);
$N1204: rgb(57.33% 65.72% 44.09%);
$N1205: rgb(47.76% 57.91% 32.38%);
$N1206: rgb(41.14% 49.29% 28.67%);
$N1207: rgb(34.69% 40.93% 25.01%);
$N1208: rgb(28.41% 32.85% 21.39%);
$N1209: rgb(22.32% 25.1% 17.81%);

// Forest
// ----------------------------------------------------------------------------

$N1351: rgb(84.23% 90.61% 82.24%);
$N1352: rgb(73.16% 82.63% 70.34%);
$N1353: rgb(62.24% 74.75% 58.74%);
$N1354: rgb(51.43% 66.96% 47.43%);
$N1355: rgb(40.66% 59.28% 36.4%);
$N1356: rgb(35.44% 50.42% 31.89%);
$N1357: rgb(30.32% 41.82% 27.48%);
$N1358: rgb(25.29% 33.51% 23.15%);
$N1359: rgb(20.35% 25.54% 18.92%);

// Jade
// ----------------------------------------------------------------------------

$N1501: rgb(82.02% 91.09% 84.07%);
$N1502: rgb(69.83% 83.29% 73.05%);
$N1503: rgb(57.73% 75.57% 62.29%);
$N1504: rgb(45.6% 67.9% 51.81%);
$N1505: rgb(33.15% 60.3% 41.63%);
$N1506: rgb(29.53% 51.26% 36.1%);
$N1507: rgb(25.89% 42.48% 30.72%);
$N1508: rgb(22.21% 34.01% 25.48%);
$N1509: rgb(18.47% 25.87% 20.4%);

// Mint
// ----------------------------------------------------------------------------

$N1651: rgb(80.21% 91.4% 86.22%);
$N1652: rgb(67.02% 83.73% 76.22%);
$N1653: rgb(53.77% 76.11% 66.45%);
$N1654: rgb(40.15% 68.52% 56.93%);
$N1655: rgb(25.12% 60.96% 47.67%);
$N1656: rgb(23.5% 51.8% 40.98%);
$N1657: rgb(21.57% 42.92% 34.48%);
$N1658: rgb(19.34% 34.34% 28.19%);
$N1659: rgb(16.8% 26.09% 22.12%);

// Cyan
// ----------------------------------------------------------------------------

$N1801: rgb(78.94% 91.54% 88.55%);
$N1802: rgb(64.98% 83.93% 79.65%);
$N1803: rgb(50.74% 76.36% 70.93%);
$N1804: rgb(35.56% 68.8% 62.42%);
$N1805: rgb(16.33% 61.27% 54.12%);
$N1806: rgb(17.56% 52.06% 46.2%);
$N1807: rgb(17.67% 43.12% 38.52%);
$N1808: rgb(16.94% 34.49% 31.1%);
$N1809: rgb(15.51% 26.2% 23.97%);

// Teal
// ----------------------------------------------------------------------------

$N1951: rgb(78.33% 91.51% 90.88%);
$N1952: rgb(63.93% 83.89% 83.09%);
$N1953: rgb(49.03% 76.3% 75.43%);
$N1954: rgb(32.59% 68.75% 67.92%);
$N1955: rgb(6.301% 61.22% 60.57%);
$N1956: rgb(12.57% 52.02% 51.42%);
$N1957: rgb(14.88% 43.09% 42.56%);
$N1958: rgb(15.41% 34.46% 34.02%);
$N1959: rgb(14.76% 26.17% 25.83%);

// Capri
// ----------------------------------------------------------------------------

$N2101: rgb(78.44% 91.29% 93.07%);
$N2102: rgb(64.02% 83.59% 86.31%);
$N2103: rgb(48.98% 75.95% 79.64%);
$N2104: rgb(32.12% 68.36% 73.07%);
$N2105: rgb(0.31% 60.82% 66.6%);
$N2106: rgb(10.99% 51.68% 56.3%);
$N2107: rgb(14.24% 42.81% 46.34%);
$N2108: rgb(15.18% 34.25% 36.75%);
$N2109: rgb(14.72% 26.03% 27.57%);

// Sky
// ----------------------------------------------------------------------------

$N2251: rgb(79.29% 90.91% 94.96%);
$N2252: rgb(65.28% 83.06% 89.09%);
$N2253: rgb(50.71% 75.29% 83.27%);
$N2254: rgb(34.55% 67.62% 77.51%);
$N2255: rgb(10.02% 60.03% 71.81%);
$N2256: rgb(14.62% 51.03% 60.52%);
$N2257: rgb(16.32% 42.29% 49.6%);
$N2258: rgb(16.45% 33.86% 39.1%);
$N2259: rgb(15.45% 25.76% 29.07%);

// Blue
// ----------------------------------------------------------------------------

$N2401: rgb(80.81% 90.37% 96.43%);
$N2402: rgb(67.63% 82.3% 91.25%);
$N2403: rgb(54.05% 74.36% 86.09%);
$N2404: rgb(39.41% 66.54% 80.95%);
$N2405: rgb(21.13% 58.86% 75.84%);
$N2406: rgb(21.23% 50.06% 63.78%);
$N2407: rgb(20.47% 41.53% 52.13%);
$N2408: rgb(18.99% 33.29% 40.93%);
$N2409: rgb(16.86% 25.38% 30.24%);

// Azure
// ----------------------------------------------------------------------------

$N2551: rgb(82.88% 89.72% 97.37%);
$N2552: rgb(70.83% 81.37% 92.63%);
$N2553: rgb(58.59% 73.18% 87.89%);
$N2554: rgb(45.8% 65.15% 83.15%);
$N2555: rgb(31.59% 57.31% 78.42%);
$N2556: rgb(28.74% 48.79% 65.87%);
$N2557: rgb(25.66% 40.52% 53.74%);
$N2558: rgb(22.34% 32.55% 42.09%);
$N2559: rgb(18.78% 24.9% 30.98%);

// Indigo
// ----------------------------------------------------------------------------

$N2701: rgb(85.33% 88.98% 97.72%);
$N2702: rgb(74.6% 80.3% 93.15%);
$N2703: rgb(63.83% 71.8% 88.56%);
$N2704: rgb(52.86% 63.49% 83.97%);
$N2705: rgb(41.44% 55.41% 79.36%);
$N2706: rgb(36.28% 47.24% 66.64%);
$N2707: rgb(31.16% 39.32% 54.34%);
$N2708: rgb(26.06% 31.67% 42.52%);
$N2709: rgb(20.98% 24.33% 31.26%);

// Violet
// ----------------------------------------------------------------------------

$N2851: rgb(87.97% 88.21% 97.47%);
$N2852: rgb(78.61% 79.16% 92.76%);
$N2853: rgb(69.29% 70.3% 88.05%);
$N2854: rgb(59.95% 61.64% 83.34%);
$N2855: rgb(50.52% 53.22% 78.61%);
$N2856: rgb(43.45% 45.47% 66.03%);
$N2857: rgb(36.54% 37.95% 53.87%);
$N2858: rgb(29.81% 30.69% 42.19%);
$N2859: rgb(23.26% 23.71% 31.05%);

// Magenta
// ----------------------------------------------------------------------------

$N3001: rgb(90.6% 87.46% 96.62%);
$N3002: rgb(82.55% 78.02% 91.51%);
$N3003: rgb(74.55% 68.78% 86.41%);
$N3004: rgb(66.58% 59.73% 81.31%);
$N3005: rgb(58.62% 50.89% 76.23%);
$N3006: rgb(49.92% 43.6% 64.1%);
$N3007: rgb(41.48% 36.53% 52.38%);
$N3008: rgb(33.31% 29.68% 41.12%);
$N3009: rgb(25.45% 23.08% 30.37%);

// Purple
// ----------------------------------------------------------------------------

$N3151: rgb(93.04% 86.78% 95.24%);
$N3152: rgb(86.15% 76.99% 89.48%);
$N3153: rgb(79.26% 67.36% 83.75%);
$N3154: rgb(72.39% 57.9% 78.05%);
$N3155: rgb(65.5% 48.6% 72.39%);
$N3156: rgb(55.48% 41.79% 61%);
$N3157: rgb(45.76% 35.15% 49.99%);
$N3158: rgb(36.39% 28.71% 39.39%);
$N3159: rgb(27.4% 22.48% 29.27%);

// Rose
// ----------------------------------------------------------------------------

$N3301: rgb(95.12% 86.23% 93.42%);
$N3302: rgb(89.17% 76.14% 86.8%);
$N3303: rgb(83.17% 66.18% 80.25%);
$N3304: rgb(77.1% 56.35% 73.78%);
$N3305: rgb(70.96% 46.61% 67.39%);
$N3306: rgb(59.91% 40.21% 56.95%);
$N3307: rgb(49.21% 33.97% 46.85%);
$N3308: rgb(38.89% 27.89% 37.13%);
$N3309: rgb(29.01% 21.99% 27.82%);

// Pink
// ----------------------------------------------------------------------------

$N3451: rgb(96.72% 85.86% 91.28%);
$N3452: rgb(91.46% 75.55% 83.66%);
$N3453: rgb(86.07% 65.37% 76.17%);
$N3454: rgb(80.54% 55.26% 68.8%);
$N3455: rgb(74.87% 45.18% 61.56%);
$N3456: rgb(63.1% 39.09% 52.23%);
$N3457: rgb(51.7% 33.13% 43.19%);
$N3458: rgb(40.72% 27.32% 34.48%);
$N3459: rgb(30.2% 21.65% 26.13%);

// Red
// ----------------------------------------------------------------------------

$N3601: rgb(97.75% 85.69% 88.98%);
$N3602: rgb(92.9% 75.29% 80.28%);
$N3603: rgb(87.85% 65% 71.76%);
$N3604: rgb(82.6% 54.78% 63.43%);
$N3605: rgb(77.13% 44.54% 55.3%);
$N3606: rgb(64.96% 38.59% 47.16%);
$N3607: rgb(53.17% 32.76% 39.26%);
$N3608: rgb(41.81% 27.06% 31.63%);
$N3609: rgb(30.93% 21.49% 24.31%);""")
sddp = ShapeDiverDocumentPayload({AbsoluteTolerance=0, AngleTolerance=0, DistanceDisplayPrecision=0, GltfVersion="Gltf2", GrasshopperVersion="1.0.0007", InputGroups="{}", OutputGroups="{}", RelativeTolerance=0, RhinoVersion="7.36.23346.16351", UnitSystem=0, VersionCreated="1.16.1.0", VersionSaved="1.16.1.0"})
python = GhPythonScript(input_text=panel)  # -> out, section_names, colors_rgb_int, color_names
# ---------- python: Python ----------
import Rhino
import scriptcontext as sc
import re
import System.Drawing.Color

# Function to parse the input text and extract necessary information
def parse_colors(input_text):
    section_names = []
    colors_rgb_int = []
    color_names = []
    
    current_section = ""
    for line in input_text.splitlines():
        if line.startswith("//") and not line.startswith("$") and not line.startswith("// -"):
            current_section = line.strip("//").strip()
            section_names.append(current_section)
        elif line.startswith("$"):
            # Extract color name and RGB values
            match = re.match(r"\$(N\d+): rgb\(([\d.]+)% ([\d.]+)% ([\d.]+)%\);", line)
            if match:
                name, r, g, b = match.groups()
                # Convert percentage RGB to integer RGB
                rgb_percentages = [float(r), float(g), float(b)]
                rgb_integers = [round((val / 100) * 255) for val in rgb_percentages]
                # Create a System.Drawing.Color object
                color = System.Drawing.Color.FromArgb(rgb_integers[0], rgb_integers[1], rgb_integers[2])
                colors_rgb_int.append(color)
                color_names.append(name)
    
    return section_names, colors_rgb_int, color_names

# Parsing the input text
section_names, colors_rgb_int, color_names = parse_colors(input_text)

# Setting component message
ghenv.Component.Message = "Convert Color Codes"
# ---------- end python ----------
clean = CleanTree(RemoveNulls=True, RemoveInvalid=True, RemoveEmpty=invert(False), Tree=python.section_names)
clean_2 = CleanTree(RemoveNulls=True, RemoveInvalid=True, RemoveEmpty=invert(False), Tree=python.colors_rgb_int)
clean_3 = CleanTree(RemoveNulls=True, RemoveInvalid=True, RemoveEmpty=invert(False), Tree=python.color_names)
flatten = FlattenTree(Tree=clean, Path="{0}")
flatten_2 = FlattenTree(Tree=clean_2, Path="{0}")
flatten_3 = FlattenTree(Tree=clean_3, Path="{0}")
graft = GraftTree(Tree=flatten, IncludeEmptyLists=True, IncludeNullItems=True)
partition = PartitionList(List=flatten_2, Size="9")
partition_2 = PartitionList(List=flatten_3, Size="9")
panel_2 = Panel(graft)
panel_3 = Panel(partition)
panel_4 = Panel(partition_2)
tstat = TreeStatistics(Tree=partition)  # -> Paths, Length, Count
col = Colour(partition)
cset = CreateSet(List=tstat.Length)  # -> Set, Map
flatten_4 = FlattenTree(Tree=col, Path="{0}")
number_slider = Slider(462, range=0..1000)
buildbmp = BuildBitmap(Width=cset.Set, Height=tstat.Count, Colors=flatten_4)
resizeimg = ResizeImage(Image=buildbmp, Mode=0, Width=number_slider, Height=number_slider)
previmg = PrevImage(SmartBitmap=resizeimg)
